# Grasshopper definition teste03.gh (Grasshopper 0.9.76)
# plug-ins: Python Interpreter

python_script = PythonScript(
    Nx=Slider(4, range=0..10),
    Dx=Slider(5, range=0..20),
    Ny=Slider(2, range=0..10),
    Dy=Slider(5, range=0..20),
    Nz=Slider(3, range=0..10),
    Dz=Slider(5, range=0..20))  # -> out, nodeCoord, nodeTag; inputs Nx: Int32, Ny: Int32, Nz: Int32
# ---------- python_script: Python ----------
import rhinoscriptsyntax as rs

nodeCoord =[]
nodeTag =[]

def node(i, x, y, z):
    nodeTag.append(i)
    nodeCoord.append(rs.AddPoint([x,y,z]))
    


NxBase = Nx +1
NyBase = Ny +1

#Nos da base
for I in range(0,NxBase*NyBase, 1):
    node(I, (I % NxBase)*(Dx), ((I % (NxBase*NyBase))//NxBase)*(Dy), 0)




Nx2 = Nx*2 +1
Ny2 = Ny*2 +1

Dx2  = Dx*0.5
Dy2  = Dy*0.5

# Definição da função com o Número de nós Npts e índice dos nós (tags) I
Npts = (Nx2)*(Ny2)*(Nz) + ( NxBase * NyBase )
for I in range(NxBase*NyBase, Npts, 1):
    node(I, ((I - NxBase*NyBase) % Nx2)*(Dx2), (((I - NxBase*NyBase) % (Nx2*Ny2))//Nx2)*(Dy2), (((I - NxBase*NyBase) // (Nx2*Ny2)) + 1)*Dz)
    
NxE = Nx * 2

for I in range(0, NxE*NyBase*Nz ,1):
    print 'eletag ', I, ' no inicial ', I + (NxBase*NyBase)  + ((I//NxE)*(Nx2+1)) - (I//(NxE*NyBase)*(Nx*Ny+1)) , ' no final ', I + (NxBase*NyBase)  + ((I//NxE)*(Nx2+1)) - (I//(NxE*NyBase)*(Nx*Ny+1))+1
# ---------- end python_script ----------
text_tag_3d = TextTag3D(Location=python_script.nodeCoord, Text=python_script.nodeTag, Size=Slider(1, range=0..10), Justification=7)
panel = Panel(python_script.out)
